# Grasshopper definition assignment-01.gh (Grasshopper 1.0.8)

# ---- group: Auto-reloads cdf module on VScode changes
path = FilePath("/Users/nicolawu/Documents/workspace/cdf1_teaching/src/")
autoreloader = Python3Script(src_path=path)  # -> out; inputs src_path: String
# ---------- autoreloader: Python ----------
#! python3
import sys, os, time
import scriptcontext as sc
import Rhino, System
from System.IO import FileSystemWatcher, NotifyFilters

VERSION = 1  
pkg = "cdf"

if not src_path:
    raise Exception("Connect a folder to src_path.")
path = os.path.normpath(src_path)
watch_dir = os.path.join(path, pkg)
if not os.path.isdir(watch_dir):
    raise Exception("No '{}' folder found in:\n{}".format(pkg, path))

def unload():
    for name in list(sys.modules):
        if name == pkg or name.startswith(pkg + "."):
            del sys.modules[name]

# Put this folder first in Python's search list
if path in sys.path:
    sys.path.remove(path)
sys.path.insert(0, path)

key = "cdf_watcher_" + str(ghenv.Component.InstanceGuid)
time_key = key + "_time"
version_key = key + "_version"

def stamp():
    sc.sticky[time_key] = time.strftime("%Y-%m-%d %H:%M:%S")

# Replace the old watcher if the folder changed or the script was updated
old = sc.sticky.get(key)
if old is not None and (os.path.normpath(old.Path) != watch_dir
                        or sc.sticky.get(version_key) != VERSION):
    old.Dispose()
    del sc.sticky[key]
    unload()

if key not in sc.sticky:
    comp = ghenv.Component
    last = [0.0]

    def reload_and_rerun():
        unload()
        stamp()
        doc = comp.OnPingDocument()
        if doc is None:            # reloader was deleted or the file closed
            return
        for obj in doc.Objects:
            if "Python" in obj.GetType().Name:
                obj.ExpireSolution(False)   # mark as out of date
        doc.NewSolution(False)              # recompute once

    def on_change(sender, e):
        if not e.FullPath.endswith(".py") or "__pycache__" in e.FullPath:
            return
        if time.time() - last[0] < 0.5:     # ignore the second event of a double save
            return
        last[0] = time.time()
        Rhino.RhinoApp.InvokeOnUiThread(System.Action(reload_and_rerun))

    w = FileSystemWatcher(watch_dir, "*.py")
    w.IncludeSubdirectories = True
    w.NotifyFilter = NotifyFilters.LastWrite
    w.Changed += on_change
    w.EnableRaisingEvents = True
    sc.sticky[key] = w
    sc.sticky[version_key] = VERSION
    stamp()                                  # time the watcher started

msg = "Last reloaded: {}\nWatching: {}".format(sc.sticky.get(time_key, "unknown"), watch_dir)
print(msg)
out = msg
# ---------- end autoreloader ----------
panel = Panel(autoreloader)

# ---- group: 1 Frame
frame_dimensions = Slider(15, range=1..30)
frame_width = Slider(1.6, range=0.5..3)
pln = Plane(PlaneXY(-100, 0, 0))
frame = Python3Script(pln=pln, w=frame_dimensions, l=frame_dimensions, h=frame_dimensions, border=frame_width)  # -> out, frame_module2; inputs pln: Plane
# ---------- frame: Python ----------
from cdf import create_cuboid_frame

frame_module2=create_cuboid_frame(base_plane=None,width=w,height=h,length=l,border_width=border)
# ---------- end frame ----------

# ---- group: Frame Grid
copies_z = Slider(6, range=0..10)
copies_y = Slider(1, range=0..10)
frame_distance = Slider(-1, range=-1..30)
copies_x = Slider(8, range=0..10)
addition = Addition(A=frame_dimensions, B=frame_distance)
frame_2 = Python3Script(brep=frame.frame_module2, x=addition, y=addition, z=addition, count_x=copies_x, count_y=copies_y, count_z=copies_z)  # -> out, stick_grid; inputs brep: Brep; same code as frame_4

# ---- group: SPHERES ON CURVE
radius = Slider(8.2, range=0..10)
sphere_distance = Slider(20.65, range=0..30)
seed = Slider(7, range=0..10)
pt = Point(Point(-86.25619224, 37.82140099, -110.3605236))
pt_2 = Point(Point(-22.20664272, 37.82140099, -89.26214594))
pt_3 = Point(Point(0, -54.10221007, 17.03043602))
pt_4 = Point(Point(6.998527778, -71.48755233, 115.5684198))
pt_5 = Point(Point(-31.9692534, 46.35039378, 68.87483762))
pt_6 = Point(Point(0, 67.9124997, 83.33505431))
pt_7 = Point(Point(69.18619304, 2.59828182, 85.06237019))
pt_8 = Point(Point(-29.49924356, -239.1632586, -82.12385718))
pt_9 = Point(Point(0, 12.60561657, 55.58842753))
pt_10 = Point(Point(69.18619304, -36.77682248, -57.22735376))
point_list = Merge(Data1=pt, Data2=pt_2, Data3=pt_3, Data4=pt_4, Data5=pt_5, Data6=pt_6, Data7=pt_9, Data8=pt_7, Data9=pt_10, Data10=pt_8)
pt_11 = Point(Point(-20, 0, 27.36938458))
curve = Interpolate(Vertices=point_list, Degree=3, Periodic=False, KnotStyle=1)  # -> Curve, Length, Domain
sqhere = Python3Script(pt=pt_11, r=radius)  # -> out, sphere_module; inputs pt: Point3d
# ---------- sqhere: Python ----------
from cdf import create_sphere

sphere_module=create_sphere(base_point=pt, radius=r)
# ---------- end sqhere ----------
copy_along_curve = Python3Script(b=sqhere.sphere_module, d=sphere_distance, c=curve.Curve)  # -> out, slide; inputs b: Brep, x: Int32, c: Curve
# ---------- copy_along_curve: Python ----------
from cdf import copy_brep_along_curve

slide=copy_brep_along_curve(brep=b, spline=c, distance=d, copy_count=x)
# ---------- end copy_along_curve ----------
random_colors = Python3Script(
    spheres=copy_along_curve.slide,
    seed=seed,
    color1=ColourSwatch(SwatchColor=RGB(171, 0, 0)),
    color2=ColourSwatch(SwatchColor=RGB(214, 105, 105)),
    color3=ColourSwatch(SwatchColor=RGB(255, 255, 255)))  # -> out, color; inputs spheres: list of Brep
# ---------- random_colors: Python ----------
from cdf import random_colors_for_spheres

color=random_colors_for_spheres(spheres, seed, color1, color2, color3)
# ---------- end random_colors ----------
preview = CustomPreview(Geometry=copy_along_curve.slide, Material=random_colors.color)

# ----
wip = WIP()
tolerance = Slider(1.2, range=0.5..3)
radius_2 = Slider(1, range=0.5..3)
addition_2 = Addition(A=radius, B=tolerance)
curve_cylinder = Python3Script(curve=curve.Curve, r=radius_2)  # -> out, cylinder; inputs curve: Curve, r: Double
# ---------- curve_cylinder: Python ----------
from cdf import create_cylinder_along_curve

cylinder=create_cylinder_along_curve(curve, radius=r)
# ---------- end curve_cylinder ----------
preview_2 = CustomPreview(Geometry=curve_cylinder.cylinder, Material=ColourSwatch(SwatchColor=RGB(255, 255, 255)))

# ---- group: kind-of-boolean
frame_3 = Python3Script(curve=curve.Curve, r=addition_2)  # -> out, boolean_cylinder; inputs curve: Curve, r: Double
# ---------- frame_3: Python ----------
from cdf import create_cylinder_along_curve

boolean_cylinder=create_cylinder_along_curve(curve, radius=r)
# ---------- end frame_3 ----------
boolean = Python3Script(breps=frame_2.stick_grid, cutter=frame_3.boolean_cylinder)  # -> out, hollow_curve; inputs breps: Brep, cutter: Brep
# ---------- boolean: Python ----------
from cdf import remove_breps_on_intersection

hollow_curve=remove_breps_on_intersection(breps, cutter, tolerance=0.001)
# ---------- end boolean ----------

# ----
merge = Merge(Data1=frame.frame_module2, Data2=boolean.hollow_curve)

# ---- group: kind-of-boolean (continued)
preview_3 = CustomPreview(Geometry=merge, Material=ColourSwatch(SwatchColor=RGB(51, 115, 184)))

# ==== cluster WIP
radius = Slider(6.7, range=0..10)
radius_2 = Slider(0, range=0..10)
radius_3 = Slider(0.3, range=0..10)
radius_4 = Slider(1, range=0..10)
radius_5 = Slider(6.5, range=0..10)
pt = Point(Point(-30, 0, 0))
xz = XZPlane(Origin=Point(0, 0, 0))
radius_6 = Slider(0, range=0..10)
pdecon = Deconstruct(Point=pt)  # -> XComponent, YComponent, ZComponent
division = Division(A=radius, B=2)
addition = Addition(B=radius_2)
addition_2 = Addition(A=radius_6, B=pdecon.XComponent)
division_2 = Division(A=radius, B=2)
yz = YZPlane(Origin=pt)
pt_2 = ConstructPoint(XCoordinate=addition, YCoordinate=division, ZCoordinate=division)
pt_3 = ConstructPoint(XCoordinate=addition_2, YCoordinate=pdecon.YComponent, ZCoordinate=pdecon.ZComponent)
pt_4 = ConstructPoint(XCoordinate=division_2, YCoordinate=division_2, ZCoordinate=0)
xy = XYPlane(Origin=pt_2)
radius_7 = Slider(2, range=-10..10)
xy_2 = XYPlane(Origin=pt_3)
pt_5 = Point(Point(0, 0, 0))
rectangle = Python3Script(pln=yz, w=radius_4, h=radius_4, l=radius_5)  # -> out, connecting_rectangle
# ---------- rectangle: Python ----------
from cdf import create_rectangle

connecting_rectangle=create_rectangle(base_plane=pln, width=w, height=h, length=l)
# ---------- end rectangle ----------
yz_2 = YZPlane(Origin=pt_4)
rectangle_2 = Python3Script(pln=xy_2, w=radius_4, h=radius_4, l=radius_5)  # -> out, connecting_rectangle; same code as rectangle
radius_8 = Slider(10, range=0..10)
radius_9 = Slider(1, range=-10..10)
frame = Python3Script(pln=xz, w=radius, l=radius_3, h=radius, border=radius_3)  # -> out, frame_module; inputs pln: Plane
# ---------- frame: Python ----------
from cdf import create_frame

frame_module=create_frame(base_plane=pln, width=w, height=h, length=l, border_width=border)
# ---------- end frame ----------
frame_2 = Python3Script(pln=xy, w=radius, l=radius_3, h=radius, border=radius_3)  # -> out, frame_module; inputs pln: Plane; same code as frame
bcentric = Barycentric(PointA=pt_2, PointB=pt_4, PointC=pt_5, CoordinateU=1, CoordinateV=1, CoordinateW=1)
addition_3 = Addition(B=radius_7)
pt_6 = Point(Point(3.057654011, 6.826642193, -4.192865288))
pt_7 = Point(Point(-3.37691709, 0.01053077055, -3.690587156))
frame_3 = Python3Script(pln=yz_2, w=radius, l=radius_3, h=radius, border=radius_3)  # -> out, frame_module; inputs pln: Plane; same code as frame
z_copies = Slider(4, range=-10..10)
radius_10 = Slider(4, range=-10..10)
radius_11 = Slider(10.5, range=0..10.5)
merge = Merge(Data1=frame.frame_module, Data2=frame_2.frame_module, Data3=frame_3.frame_module)
pl = ConstructPlane(Origin=bcentric, XAxis=pt_7, YAxis=pt_6)
frame_4 = Python3Script(
    brep=rectangle_2.connecting_rectangle,
    x=addition_3,
    y=addition_3,
    z=addition_3,
    count_x=radius_9,
    count_y=radius_9,
    count_z=radius_9)  # -> out, stick_grid; inputs brep: Brep
# ---------- frame_4: Python ----------
from cdf import copy_brep_along_xyz

stick_grid=copy_brep_along_xyz(brep, distance_x=x, distance_y=y, distance_z=z,
                        copy_count_x=count_x, copy_count_y=count_y, copy_count_z=count_z)
# ---------- end frame_4 ----------
frame_5 = Python3Script(
    brep=rectangle.connecting_rectangle,
    x=addition_3,
    y=addition_3,
    z=addition_3,
    count_x=radius_9,
    count_y=radius_9,
    count_z=radius_9)  # -> out, stick_grid; inputs brep: Brep; same code as frame_4
mirror = Mirror(Geometry=merge, Plane=pl)  # -> Geometry, Transform
frame_6 = Python3Script(brep=frame_3.frame_module, x=radius_11, y=radius_11, z=radius_11, count_x=radius_10, count_y=radius_10, count_z=z_copies)  # -> out, stick_grid; inputs brep: Brep; same code as frame_4
frame_7 = Python3Script(brep=frame_2.frame_module, x=radius_11, y=radius_11, z=radius_11, count_x=radius_10, count_y=radius_10, count_z=z_copies)  # -> out, stick_grid; inputs brep: Brep; same code as frame_4
frame_8 = Python3Script(brep=merge, x=radius_11, y=radius_11, z=radius_11, count_x=radius_10, count_y=radius_10, count_z=z_copies)  # -> out, stick_grid; inputs brep: Brep; same code as frame_4
